# Dynamo graph EquipDiscNamer.dyn (Dynamo 2.19.3.6394)

select_model_elements = DSModelElementsSelection()  # 1 picked in the model; graph input
getEquipDiscFed = Custom[GetEquipDiscFed](element=select_model_elements)  # verifies if the family type is "EQ - Equipment Disconnect Switch". The downstream device name is assigned to EQ_EquipmentDisconnectDownstreamDevice and EQ_EquipmentDisconnectNameCombined for each selected element if the family type check passes.
output = Watch(getEquipDiscFed)  # graph output
