# Dynamo graph LF-Cylinder Tags.dyn (Dynamo 2.19.3.6394)
# packages: Genius Loci 2024.2.26

# group: INPUT
# It takes one or multiple elements
select_model_elements = DSModelElementsSelection()  # 3 picked in the model; graph input

# group: DATA
# - Element.GetLocation gives the coordinate (x,y,z) of the element(s)
# - ElementWidths is a script that only extracts the width of the element(s)
getLocation = Element.GetLocation(element=select_model_elements)
getElementRadius = Python(IN[0]=select_model_elements)  # CPython3
# ---------- getElementRadius.python (58 lines) ----------
import clr
import sys
sys.path.append('C:\\Program Files (x86)\\IronPython 2.7\\Lib')
import System
from System import Array

# Import Revit libraries
clr.AddReference('ProtoGeometry')
from Autodesk.DesignScript.Geometry import *
clr.AddReference('RevitNodes')
import Revit
clr.ImportExtensions(Revit.Elements)

clr.AddReference('RevitServices')
import RevitServices
from RevitServices.Persistence import DocumentManager
from RevitServices.Transactions import TransactionManager
from System.Collections.Generic import *

clr.AddReference('RevitAPI')
clr.AddReference('RevitAPIUI')
import Autodesk
from Autodesk.Revit.DB import *

# Input Revit elements (single or multiple)
input_elements = IN[0] if isinstance(IN[0], list) else [IN[0]]

# Initialize a list to store radii
radii = []

# Function to retrieve parameter value in feet
def get_parameter_value(element_type, parameter_name):
    param = element_type.LookupParameter(parameter_name)
    if param and param.StorageType == StorageType.Double:
        return param.AsDouble()  # Value in feet
    return None

# Loop through each element
for input_element in input_elements:
    element = UnwrapElement(input_element)  # Unwrap the input Revit element
    if element is not None:
        # Access the type of the element
        element_type_id = element.GetTypeId()
        if element_type_id != ElementId.InvalidElementId:
            element_type = element.Document.GetElement(element_type_id)
            
            # Retrieve "Radius" and "Outer Radius" values
            radius = get_parameter_value(element_type, "Radius")
            outer_radius = get_parameter_value(element_type, "Outer Radius")
            
            # Append values to the radii list
            if radius is not None:
                radii.append(radius)
            if outer_radius is not None:
                radii.append(outer_radius)

# Output all radii values
OUT = radii if len(radii) > 1 else (radii[0] if radii else None)
# ----------------------------------------
getLocation_2 = Element.GetLocation(element=select_model_elements)

# group: POSITION TRACKER
# LocationManager 1 and LocationManager 2, both calculate new point coordinates based on input Pt (a point) and a (a value). Both blocks define new X and Y coordinates (newX, newY) using slightly different formulas to create a new point using Point.ByCoordinates
locationmanager_2 = CodeBlock(Pt=getLocation, a=getElementRadius) { point = Pt; r = 3 * a; l = a + 0.7; newX = point.X + r; newY = point.Y + l; Point.ByCoordinates(newX, newY, point.Z); }
locationmanager_1 = CodeBlock(Pt=getLocation_2, a=getElementRadius) { point = Pt; r = 2 * a; l = a + 0.5; newX = point.X + r; newY = point.Y - l; Point.ByCoordinates(newX, newY, point.Z); }

# group: TAG USED
family_types = FamilyTypes("SEI_Tag - LF Type Mark:SEI_Tag - LF Type Mark")
family_types_2 = FamilyTypes("SEI_Tag - LF Circuit:SEI_Tag - LF Circuit")

# group: RUNNER
# If "True" it will run and if "False" it won't run.
boolean = BoolSelector(true)

# group: NEW TAGS
create_tag = Custom[Create Tag](element=select_model_elements, TagLocation=locationmanager_2.out5, TagType=family_types, RunIt=boolean)  # package Genius Loci; Works only in Revit 2018 and later. Creates a tag at a given location, of given type and in a supplied view. The node also works with Linked Elements (except space and area), Multi Category tag and Material Tag. Based on an archilab node
create_tag_2 = Custom[Create Tag](element=select_model_elements, TagLocation=locationmanager_1.out5, TagType=family_types_2, RunIt=boolean)

# group: OUTPUT
output = Watch(create_tag)
