# Dynamo graph LF-Linear Tags.dyn (Dynamo 2.19.3.6394)
# packages: Genius Loci 2024.2.26

# group: INPUT
# It takes one or multiple elements
select_model_elements = DSModelElementsSelection()  # 3 picked in the model; graph input

# group: DATA
# - Element.GetLocation gives the coordinate (x,y,z) of the element(s)
# - GetElementLengthss is a script that only extracts the width of the element(s)
getLocation = Element.GetLocation(element=select_model_elements)
getElementLengths = Python(IN[0]=select_model_elements)  # CPython3
# ---------- getElementLengths.python (47 lines) ----------
import clr
import sys
sys.path.append('C:\\Program Files (x86)\\IronPython 2.7\\Lib')
import System
from System import Array

# Import Revit libraries
clr.AddReference('ProtoGeometry')
from Autodesk.DesignScript.Geometry import *
clr.AddReference('RevitNodes')
import Revit
clr.ImportExtensions(Revit.Elements)

clr.AddReference('RevitServices')
import RevitServices
from RevitServices.Persistence import DocumentManager
from RevitServices.Transactions import TransactionManager
from System.Collections.Generic import *

clr.AddReference('RevitAPI')
clr.AddReference('RevitAPIUI')
import Autodesk
from Autodesk.Revit.DB import *

# Input Revit elements (single or multiple)
input_elements = IN[0] if isinstance(IN[0], list) else [IN[0]]

# Initialize a list to hold widths
widths = []

# Loop through each element
for input_element in input_elements:
    element = UnwrapElement(input_element)
    if element is not None:
        options = Options()
        geometry_element = element.get_Geometry(options)
        if geometry_element is not None:
            bounding_box = element.get_BoundingBox(None)
            if bounding_box is not None:
                # Extract width from the bounding box
                min_point = bounding_box.Min
                max_point = bounding_box.Max
                width = int(abs(max_point.X - min_point.X))  # Convert to integer
                widths.append(width)

# Output the list of widths (or single value if only one element)
OUT = widths if len(widths) > 1 else widths[0]
# ----------------------------------------
getLocation_2 = Element.GetLocation(element=select_model_elements)

# group: POSITION TRACKER
# LocationManager 1 and LocationManager 2, both calculate new point coordinates based on input Pt (a point) and a (a value). Both blocks define new X and Y coordinates (newX, newY) using slightly different formulas to create a new point using Point.ByCoordinates
locationmanager_2 = CodeBlock(Pt=getLocation, a=getElementLengths) { point = Pt; l = a/2; newX = point.X - l + 0.7; newY = point.Y + 1.5; Point.ByCoordinates(newX, newY, point.Z); }
locationmanager_1 = CodeBlock(Pt=getLocation_2, a=getElementLengths) { point = Pt; l = a/2; newX = point.X - l + 0.4; newY = point.Y - 1.5; Point.ByCoordinates(newX, newY, point.Z); }

# group: TAG USED
family_types = FamilyTypes("SEI_Tag - LF Type Mark:SEI_Tag - LF Type Mark")
family_types_2 = FamilyTypes("SEI_Tag - LF Circuit:SEI_Tag - LF Circuit")

# group: RUNNER
# If "True" it will run and if "False" it won't run.
boolean = BoolSelector(true)

# group: NEW TAGS
create_tag = Custom[Create Tag](element=select_model_elements, TagLocation=locationmanager_2.out4, TagType=family_types, RunIt=boolean)  # package Genius Loci; Works only in Revit 2018 and later. Creates a tag at a given location, of given type and in a supplied view. The node also works with Linked Elements (except space and area), Multi Category tag and Material Tag. Based on an archilab node
create_tag_2 = Custom[Create Tag](element=select_model_elements, TagLocation=locationmanager_1.out4, TagType=family_types_2, RunIt=boolean)

# group: OUTPUT
output = Watch(create_tag)
