# Dynamo graph LF-Linear Wall Mounted Tags.dyn (Dynamo 2.19.3.6394)
# packages: Genius Loci 2024.2.26

# group: INPUT
# It takes one or multiple elements
select_model_elements = DSModelElementsSelection()  # 2 picked in the model; graph input

# group: DATA
# - Element.GetLocation gives the coordinate (x,y,z) of the element(s)
# - ElementWidths is a script that only extracts the width of the element(s)
getLocation = Element.GetLocation(element=select_model_elements)
getLocation_2 = Element.GetLocation(element=select_model_elements)

# group: POSITION TRACKER
# LocationManager 1 and LocationManager 2, both calculate new point coordinates based on input Pt (a point) and a (a value). Both blocks define new X and Y coordinates (newX, newY) using slightly different formulas to create a new point using Point.ByCoordinates
locationmanager_2 = CodeBlock(Pt=getLocation) { point = Pt; newX = point.X - 2; newY = point.Y + 0.48; Point.ByCoordinates(newX, newY, point.Z); }
locationmanager_1 = CodeBlock(Pt=getLocation_2) { point = Pt; newX = point.X + 1.53; newY = point.Y + 0.48; Point.ByCoordinates(newX, newY, point.Z); }

# group: TAG USED
family_types = FamilyTypes("SEI_Tag - LF Type Mark:SEI_Tag - LF Type Mark")
family_types_2 = FamilyTypes("SEI_Tag - LF Circuit:SEI_Tag - LF Circuit")

# group: RUNNER
# If "True" it will run and if "False" it won't run.
boolean = BoolSelector(true)

# group: NEW TAGS
create_tag = Custom[Create Tag](element=select_model_elements, TagLocation=locationmanager_2.out3, TagType=family_types, RunIt=boolean)  # package Genius Loci; Works only in Revit 2018 and later. Creates a tag at a given location, of given type and in a supplied view. The node also works with Linked Elements (except space and area), Multi Category tag and Material Tag. Based on an archilab node
create_tag_2 = Custom[Create Tag](element=select_model_elements, TagLocation=locationmanager_1.out3, TagType=family_types_2, RunIt=boolean)

# group: OUTPUT
output = Watch(create_tag)
