# Dynamo graph MechComboMotorStarterDiscNamer.dyn (Dynamo 2.19.3.6394)

select_model_elements = DSModelElementsSelection()  # 1 picked in the model; graph input
getMechCombMotorStarterDisc = Custom[GetMechCombMotorStarterDisc](element=select_model_elements)
watch = Watch(getMechCombMotorStarterDisc)  # graph output
