# Dynamo graph MechEquipDiscNamer.dyn (Dynamo 2.19.3.6394)

select_model_elements = DSModelElementsSelection()  # 2 picked in the model; graph input
getMechEquipDisc = Custom[GetMechEquipDisc](element=select_model_elements)  # Checks if the device is a mechanical Equipment Disconnect Switch, then Gathers downstream and upstream connections, and assigns the downstream device name to EQ_MechanicalEquipmentDisconnectDownstreamDevice and EQ_MechanicalEquipmentDisconnectNameCombined if the family check passes.
watch = Watch(getMechEquipDisc)  # graph output
