# Dynamo graph MechMotorStarterNamer.dyn (Dynamo 2.19.3.6394)

select_model_elements = DSModelElementsSelection()  # 1 picked in the model; graph input
getMechMotorStarter = Custom[GetMechMotorStarter](element=select_model_elements)  # The script now checks for "EQ - Mechanical Motor Starter" . The downstream device name is assigned to EQ_MechanicalMotorStarterDownstreamDevice and EQ_MechanicalMotorStarterNameCombined for each selected element that meets the family type check.
watch = Watch(getMechMotorStarter)  # graph output
