# Dynamo graph Panel&SwitchboardNamer.dyn (Dynamo 2.19.3.6394)

select_model_elements = DSModelElementsSelection()  # 4 picked in the model; graph input
getElementNameCombined = Custom[GetElementNameCombined](element=select_model_elements)  # Retrieves Parameter Values: Collects the values for the specified parameters and filters the "Level" parameter to include only numeric characters. - Collects parameter values and filters the "Level" value to include only numbers. - Tracks similar parameter combinations, incrementing an alphabetic index (A, B, C, etc.) for repeated cases. - Generates a unique identifier by appending the index to the concatenated parameter values. - Updates Revit parameters: Sets "EQ_EquipmentNameCombined" to the unique string and "EQ_Identifier" to the index. Outputs the list of "EQ_EquipmentNameCombined" values for all elements.
watch = Watch(getElementNameCombined)  # graph output
