# Dynamo graph TransformerNamer.dyn (Dynamo 2.19.3.6394)

select_model_elements = DSModelElementsSelection()  # 7 picked in the model; graph input
getTransformerFedsFeed = Custom[GetTransformerFedsFeed](element=select_model_elements)  # It ouputs the downstream and upstream connections of the Transformer
watch = Watch(getTransformerFedsFeed)  # graph output
