# Dynamo graph UtilityPadMountedXFRMNamer.dyn (Dynamo 2.19.3.6394)

select_model_elements = DSModelElementsSelection()  # 1 picked in the model; graph input
getPadMountedTransf = Custom[GetPadMountedTransf](element=select_model_elements)
watch = Watch(getPadMountedTransf)  # graph output
