# Dynamo graph VFDNamer.dyn (Dynamo 2.19.3.6394)

select_model_elements = DSModelElementsSelection()  # 4 picked in the model; graph input
getVFD = Custom[GetVFD](element=select_model_elements)
watch = Watch(getVFD)  # graph output
